# Dynamo graph Enumerate for Revit.dyn "Enumerate for Revit - (remake)" (Dynamo 2.6.1.8786)

CATEGORY = StringInput("Pilares estruturais")  # graph input
byName = Category.ByName(name=CATEGORY)
all_elements_of_category = ElementsOfCategory(Category=byName)
getLocation = Element.GetLocation(element=all_elements_of_category)
string_from_object = FromObject(obj=getLocation)
id = Element.Id(element=all_elements_of_category)
OBJECT_BUILDER = Python(IN[0]=string_from_object, IN[1]=id)
# ---------- OBJECT_BUILDER.python (23 lines) ----------
import re
import sys
import clr
clr.AddReference('ProtoGeometry')
from Autodesk.DesignScript.Geometry import *

points = IN[0]
uid = IN[1]

results = []

for index, point in enumerate(points):
	id = uid[index]
	
	x, y, z = re.sub(r'Point\(X = (.*), Y = (.*), Z = (.*)\)', r'\1,\2,\3', point).split(',')
	
	results.append({
		"id": id,
		"x": float(x),
		"y": float(y),
	})

OUT = results
# ----------------------------------------
OBJECT_SORTER = Python(IN[0]=OBJECT_BUILDER)
# ---------- OBJECT_SORTER.python (8 lines) ----------
import sys
import clr
clr.AddReference('ProtoGeometry')
from Autodesk.DesignScript.Geometry import *

coord = IN[0]

OUT = sorted(coord, key=lambda k: [-k["y"],k["x"]])
# ----------------------------------------
PREFIX = StringInput("P")  # graph input
PREFIXER = Python(IN[0]=OBJECT_SORTER, IN[1]=PREFIX)
# ---------- PREFIXER.python (28 lines) ----------
import sys
import clr
clr.AddReference('ProtoGeometry')
from Autodesk.DesignScript.Geometry import *

nodes = IN[0]
prefix = IN[1]

results = []
counter = 0

def get_name(node):
	global counter
	for item in results:
		if node["x"] == item["x"] and node["y"] == item["y"]:
			return item["name"]
			
	counter = counter + 1
	return '{prefix}{counter}'.format(prefix=prefix, counter=counter)

for node in nodes:
	result = node.copy()
	result.update({
		"name": get_name(node)
	})
	results.append(result) 

OUT = results
# ----------------------------------------
GET_IDS = Python(IN[0]=PREFIXER)
# ---------- GET_IDS.python (12 lines) ----------
import sys
import clr
clr.AddReference('ProtoGeometry')
from Autodesk.DesignScript.Geometry import *

nodes = IN[0]

results = []
for node in nodes:
	results.append(node["id"])

OUT = results
# ----------------------------------------
element_by_id = ElementById(Id=GET_IDS)
PARAMETER = StringInput("Titulo")
GET_NAMES = Python(IN[0]=PREFIXER)
# ---------- GET_NAMES.python (12 lines) ----------
import sys
import clr
clr.AddReference('ProtoGeometry')
from Autodesk.DesignScript.Geometry import *

nodes = IN[0]

results = []
for node in nodes:
	results.append(node["name"])

OUT = results
# ----------------------------------------
setParameterByName = Element.SetParameterByName(element=element_by_id, parameterName=PARAMETER, value=GET_NAMES)
